# Grasshopper definition equad.ghx (Grasshopper 1.0.7)
# plug-ins: Human, Kangaroo2 Components

number_divs = Slider(6, range=0..100)
z_tree = Slider(0, range=-10..20)
pipeline = GeometryPipeline(
    GroupByLayer=False,
    GroupByType=False,
    IncludeHidden=True,
    IncludeLocked=True,
    LayerFilter="supports",
    NameFilter="*",
    SublayerFiltering=True,
    TypeFilter=1)
pt = Point(pipeline)
crv = Curve(<curve referenced from the Rhino model>)
num = Number(number_divs)
num_2 = Number(z_tree)
num_3 = Number(Slider(0, range=0..100))
num_4 = Number(Slider(2, range=0..10))
num_5 = Number(number_divs)
pt_2 = Point(<point referenced from the Rhino model>)
crv_2 = Curve(<curve referenced from the Rhino model>)
crv_3 = Curve(crv)
num_6 = Number(num_5)
num_7 = Number(num)
boundary = BoundarySurfaces(Edges=crv_3)
sdivide = DivideSurface(Surface=boundary, UCount=num_6, VCount=num_7)  # -> simplify(Points), Normals, Parameters
pt_3 = Point(sdivide.Points)
flip = FlipMatrix(Data=sdivide.Points)
pline = PolyLine(Vertices=sdivide.Points, Closed=False)
pline_2 = PolyLine(Vertices=flip, Closed=False)
entwine = Entwine(Branch00=pline_2, Branch01=pline, FlattenInputs=True)
explode = Explode(Curve=entwine, Recursive=True)  # -> Segments, Vertices
flatten = FlattenTree(Tree=explode.Segments, Path="{0}")
crv_4 = Curve(explode.Segments)
crv_5 = Curve(entwine)
crv_6 = Curve(flatten)
pt_4 = Point(pt_3)
crv_7 = Curve(crv_5)
item = ListItem(List=crv_7, Index=0, Wrap=True)  # -> Item1, Item
relitem = RelativeItem(Tree=pt_4, Offset="{1}[1]", WrapPaths=False, WrapItems=False)  # -> ItemA, ItemB
relitem_2 = RelativeItem(Tree=pt_4, Offset="{-1}[1]", WrapPaths=False, WrapItems=False)  # -> ItemA, ItemB
merge = Merge(Data1=item.Item1, Data2=item.Item)
ln = Line(StartPoint=relitem.ItemA, EndPoint=relitem.ItemB)
ln_2 = Line(StartPoint=relitem_2.ItemA, EndPoint=relitem_2.ItemB)
crv_8 = Curve(ln)
crv_9 = Curve(ln_2)
crv_10 = Curve(merge)
crv_11 = Curve(crv_8)
crv_12 = Curve(crv_9)
crv_13 = Curve(crv_10)
flatten_2 = FlattenTree(Tree=crv_11, Path="{0}")
graft = GraftTree(Tree=crv_12, IncludeEmptyLists=True, IncludeNullItems=True)
ccx = CurveCurve(CurveA=graft, CurveB=flatten_2)  # -> Points, ParamsA, ParamsB
path_mapper = PathMapper(ccx.ParamsB, source="{A;B;C}", target="{C}")
trim = TrimTree(Tree=ccx.ParamsA, Depth=1)
shatter = Shatter(Curve=graft, Parameters=trim)
shatter_2 = Shatter(Curve=graft(flatten_2), Parameters=path_mapper)
explode_2 = Explode(Curve=shatter, Recursive=True)  # -> Segments, Vertices
explode_3 = Explode(Curve=shatter_2, Recursive=True)  # -> Segments, Vertices
crv_14 = Curve(explode_3.Segments)
crv_15 = Curve(crv_14)
crv_16 = Curve(explode_2.Segments)
crv_17 = Curve(crv_16)
entwine_2 = Entwine(Branch00=crv_17, Branch01=crv_15, Branch02=crv_13, FlattenInputs=True)
crv_18 = Curve(entwine_2)
crv_19 = Curve(crv_18)
explode_4 = Explode(Curve=crv_19, Recursive=True)  # -> Segments, Vertices
flatten_3 = FlattenTree(Tree=explode_4.Segments, Path="{0}")
crv_20 = Curve(flatten_3)
crv_21 = Curve(crv_6)
crv_22 = Curve(crv_20)
python = GhPythonScript(lines=crv_22)  # -> out, mesh, ghmesh, faces; inputs lines: list
# ---------- python: Python ----------
from compas.datastructures import Mesh

from compas_rhino.utilities import get_line_coordinates
from compas_ghpython.artists import MeshArtist


mesh = Mesh.from_lines(get_line_coordinates(lines), delete_boundary_face=True)

a = MeshArtist(mesh)
ghmesh = a.draw_mesh()
faces = a.draw_faces()
# ---------- end python ----------
data = Data(python.mesh)
mesh = Mesh(python.ghmesh)
mesh_2 = Mesh(python.faces)
pt_5 = Point(pt_2)
num_8 = Number(num_3)
mesh_3 = Mesh(mesh_2)
num_9 = Number(num_4)
dom = ConstructDomain(DomainStart=num_9, DomainEnd=num_8)
facen = FaceNormals(Mesh=mesh_3)  # -> Centers, Normals
dist = Distance(PointA=facen.Centers, PointB=pt_5)
sqr = Square(Value=dist)
bnd = Bounds(Numbers=flatten(sqr))
remap = RemapNumbers(Value=sqr, Source=bnd, Target=Domain(0, 1))  # -> Mapped, Clipped
graph = GraphMapper(
    remap.Mapped,
    x0=0,
    x1=1,
    y0=0,
    y1=1,
    container_name="Bezier",
    cpx=[0, 0.1434025466, 0, 1],
    cpy=[0, 0, 0.8176158667, 0.9953248501])
remap_2 = RemapNumbers(Value=graph, Source=Domain(0, 1), Target=dom)  # -> flatten(Mapped), Clipped
int = Integer(remap_2.Mapped)
int_2 = Integer(flatten(int))
pt_6 = Point(pt_2)
crv_23 = Curve(crv_20)
python_2 = GhPythonScript(lines=crv_23, subdivisions=int_2, attractor=pt_6)  # -> out, mesh, ghmesh, faces, edges; inputs lines: list, subdivisions: list of Int32, attractor: Point3d
# ---------- python_2: Python ----------
from compas.datastructures import Mesh
from compas.datastructures import mesh_split_edge

from compas_rhino.utilities import get_line_coordinates
from compas_ghpython.artists import MeshArtist

from compas.utilities import window
from compas.utilities import pairwise
from compas.utilities import geometric_key

from compas.geometry import is_point_in_polygon_xy
from compas.geometry import closest_point_in_cloud



def mesh_subdivide_quad(mesh, subdivisions):
    counter = 0
    base_mesh = mesh.copy()
    
    for _ in range(max(subdivisions)):
        # subd = mesh_fast_copy(mesh)
        subd = mesh.copy()
        
        # for u, v in list(subd.edges()):
        #    mesh_split_edge(subd, u, v, allow_boundary=True)
        
        for fkey in mesh.faces():
            
            centroid = mesh.face_centroid(fkey)
            
            
            for idx, ofkey in enumerate(base_mesh.faces()):
                polygon = base_mesh.face_coordinates(ofkey)
                if is_point_in_polygon_xy(centroid, polygon):
                    j = idx
                
            sval = subdivisions[j]
            if counter >= sval:
                continue
            
            edges = mesh.face_halfedges(fkey)
            for u, v in edges:
                try:
                    mesh_split_edge(subd, u, v, allow_boundary=True)
                except:
                    continue
            
            descendant = {i: j for i, j in subd.face_halfedges(fkey)}
            ancestor = {j: i for i, j in subd.face_halfedges(fkey)}
            x, y, z = mesh.face_centroid(fkey)
            c = subd.add_vertex(x=x, y=y, z=z)
            
            for key in mesh.face_vertices(fkey):
                a = ancestor[key]
                d = descendant[key]
                subd.add_face([a, key, d, c])
                
            del subd.face[fkey]
            
        mesh = subd
        counter += 1

    return subd


mesh = Mesh.from_lines(get_line_coordinates(lines), delete_boundary_face=True)
mesh = mesh_subdivide_quad(mesh, subdivisions)




# cen_fkey = {geometric_key(mesh.face_centroid(fkey) for fkey in mesh.faces()}
xyz_vkey = {geometric_key(mesh.vertex_coordinates(vkey)): vkey for vkey in mesh.vertices()}
xyz_all = map(mesh.vertex_coordinates, mesh.vertices())

_, closest, b = closest_point_in_cloud([attractor.X, attractor.Y, attractor.Z], xyz_all)
print(closest)
gkey = geometric_key(closest)

vkey = xyz_vkey[gkey]
mesh.delete_vertex(vkey)


a = MeshArtist(mesh)
ghmesh = a.draw_mesh()
faces = a.draw_faces()
edges = a.draw_edges()
# ---------- end python_2 ----------
data_2 = Data(python_2.mesh)
panel = Panel(python_2.out)
mesh_4 = Mesh(python_2.ghmesh)
crv_24 = Curve(python_2.edges)
mesh_5 = Mesh(python_2.faces)
data_3 = Data(data_2)
python_3 = GhPythonScript(mesh=data_3)  # -> out, mesh, a, b
# ---------- python_3: Python ----------
__author__ = "arpj"

import rhinoscriptsyntax as rs
from compas.utilities import geometric_key
from compas.geometry import dot_vectors
from compas.geometry import normalize_vector
from compas.geometry import subtract_vectors
from math import fabs


visited = set()
id = 0



edge1 = mesh.get_any_edge()
vector_a = normalize_vector(subtract_vectors(*mesh.edge_coordinates(*edge1)[::-1]))

visited = set()


for edge in mesh.edges():
    
    if mesh.is_edge_on_boundary(*edge):
        continue
    
    gkey = geometric_key(mesh.edge_midpoint(*edge))
    
    if gkey in visited:
        continue

    vector_b = normalize_vector(subtract_vectors(*mesh.edge_coordinates(*edge)[::-1]))
    
    dot = fabs(dot_vectors(vector_a, vector_b))
    if dot < 0.95:
        mesh.set_edge_attribute(edge, 'direction', 'u')
    else:
        mesh.set_edge_attribute(edge, 'direction', 'v')
    
    gkey = geometric_key(mesh.edge_midpoint(*edge))
    visited.add(gkey)



a = rs.JoinCurves([rs.AddLine(*mesh.edge_coordinates(*edge)) for edge in mesh.edges_where({'direction':'u'})])
b = rs.JoinCurves([rs.AddLine(*mesh.edge_coordinates(*edge)) for edge in mesh.edges_where({'direction':'v'})])
# ---------- end python_3 ----------
crv_25 = Curve(python_3.b)
data_4 = Data(python_3.mesh)
mesh_6 = Mesh(mesh_4)
data_5 = Data(data_4)
pt_7 = Point(pt)
demesh = DeconstructMesh(Mesh=mesh_6)  # -> Vertices, Faces, Colours, Normals
cp = ClosestPoint(Point=pt_7, Cloud=flatten(demesh.Vertices))  # -> ClosestPoint, CPIndex, Distance
python_4 = GhPythonScript(mesh=data_5)  # -> out, points
# ---------- python_4: Python ----------
__author__ = "arpj"


points = []
for key in mesh.vertices():
    if mesh.vertex_degree(key) == 2:
        xyz = mesh.vertex_coordinates(key)
        points.append(xyz)
# ---------- end python_4 ----------
python_5 = GhPythonScript(mesh=data_5)  # -> out, points
# ---------- python_5: Python ----------
__author__ = "arpj"


points = []
for key in mesh.vertices_on_boundary():
    print(key)
    xyz = mesh.vertex_coordinates(key)
    points.append(xyz)
# ---------- end python_5 ----------
python_6 = GhPythonScript(mesh=data_5, ghpoints=cp.ClosestPoint)  # -> out, points; inputs ghpoints: list
# ---------- python_6: Python ----------
__author__ = "arpj"


from compas_rhino.utilities import get_point_coordinates
from compas.utilities import geometric_key

ghpoints = get_point_coordinates(ghpoints)

gkey_key = mesh.gkey_key()


points = []
for ghpoint in ghpoints:
    pt = gkey_key[geometric_key(ghpoint)]
    points.append(ghpoint)
# ---------- end python_6 ----------
merge_2 = Merge(Data1=python_4.points, Data2=python_5.points, Data3=python_6.points)  # -> flatten(Result)
data_6 = Data(merge_2)
data_7 = Data(python_6.points)
data_8 = Data(data_6)
data_9 = Data(data_7)
num_10 = Number(num_2)
data_10 = Data(data_4)
python_7 = GhPythonScript(mesh=data_10, points=data_8, projected=data_9, my_z=num_10)  # -> out, mesh; inputs points: list, projected: list
# ---------- python_7: Python ----------
__author__ = "Rafael Pastrana"


import scriptcontext as sc

from copy import deepcopy
from compas.datastructures import Mesh

from compas.utilities import geometric_key

from compas_rhino.helpers import mesh_from_guid
from compas_ghpython.artists import MeshArtist

# ==============================================================================
# Call Proxy Locally
# ==============================================================================


numerical = sc.sticky['numerical']
dr_numpy = numerical.dr_numpy

dea = sc.sticky['dea']
dva = sc.sticky['dva']

# mesh builder
# mesh = mesh_from_guid(Mesh, ghmesh)
mesh = deepcopy(mesh)

# update attributes
mesh.update_default_vertex_attributes(dva)
mesh.update_default_edge_attributes(dea)

# fix vertices
gkey_key = mesh.gkey_key()
projected = [geometric_key(pt) for pt in projected]

for point in points:
    gkey = geometric_key(point)
    vkey = gkey_key[gkey]
    mesh.set_vertex_attribute(vkey, 'is_fixed', True)
    if gkey in projected:
       mesh.set_vertex_attribute(vkey, 'z', my_z)
        
for edge in mesh.edges():
    zs = []
    for vkey in edge:
        if mesh.vertex_coordinates(vkey)[2] == my_z:
            q = mesh.get_edge_attribute(edge, 'qpre')
            mesh.set_edge_attribute(edge, 'qpre', q * 12)
            
            zs.append(vkey)
    if len(zs) == 2:
        mesh.set_edge_attribute(edge, 'qpre', q*0.5)
    

# query attributes
k_i = mesh.key_index()
vertices = mesh.get_vertices_attributes(('x', 'y', 'z'))
edges = [(k_i[u], k_i[v]) for u, v in mesh.edges()]
fixed = [k_i[key] for key in mesh.vertices_where({'is_fixed': True})]
loads = mesh.get_vertices_attributes(('px', 'py', 'pz'))
qpre = mesh.get_edges_attribute('qpre')
fpre = mesh.get_edges_attribute('fpre')
lpre = mesh.get_edges_attribute('lpre')
linit = mesh.get_edges_attribute('linit')
E = mesh.get_edges_attribute('E')
radius = mesh.get_edges_attribute('radius')

# carry out dynamic relaxation with numpy

xyz, q, f, l, r = dr_numpy(vertices,
                           edges,
                           fixed,
                           loads,
                           qpre,
                           fpre,
                           lpre,
                           linit,
                           E,
                           radius,
                           kmax=100,
                           callback=None
                           )

# update vertex coordinates
for key, attr in mesh.vertices(True):
    index = k_i[key]
    attr['x'] = xyz[index][0]
    attr['y'] = xyz[index][1]
    attr['z'] = xyz[index][2]
        
# update edges' force and length attributes 
for index, (u, v, attr) in enumerate(mesh.edges(True)):
    attr['f'] = f[index]
    attr['l'] = l[index]
# ---------- end python_7 ----------
python_8 = GhPythonScript()  # -> out
# ---------- python_8: Python ----------
__author__ = "Rafael Pastrana"


import scriptcontext as sc


dva = {
    'is_fixed': False,
    'x': 0.0,
    'y': 0.0,
    'z': 0.0,
    'px': 0.0,  # x component of point load at vertices
    'py': 0.0,  # y component of point load at vertices
    'pz': 10.0,  # z component of point load at vertices
    'rx': 0.0,
    'ry': 0.0,
    'rz': 0.0,
}

dea = {
    'qpre': 10.0,  # prescribed force densities
    'fpre': 0.0,  # prescribed edge forces
    'lpre': 0.0,  # prescribed edge lengths
    'linit': 0.0,  # initial edge length
    'E': 10.0,  # initial edge length (kN/mm2 => GPa)
    'radius': 2.5, # global initial cable radius (mm)
}

sc.sticky['dva'] = dva
sc.sticky['dea'] = dea
# ---------- end python_8 ----------
data_11 = Data(python_7.mesh)
panel_2 = Panel(python_7.out)
data_12 = Data(data_11)
data_13 = Data(data_11)
data_14 = Data(data_11)
python_9 = GhPythonScript(mesh=data_12)  # -> out, vertices, edges, faces
# ---------- python_9: Python ----------
__author__ = "Rafael Pastrana"

from compas_ghpython.artists import MeshArtist


# ==============================================================================
# Visualize
# ==============================================================================

artist = MeshArtist(mesh)

# vertices = artist.draw_vertices()
edges = artist.draw_edges()
faces = artist.draw_faces()
mesh = artist.draw_mesh()
# ---------- end python_9 ----------
python_10 = GhPythonScript(mesh=data_14)  # -> out, q, forces, radius
# ---------- python_10: Python ----------
forces = [attr['f'][0] for u , v, attr in mesh.edges(True)]
# ---------- end python_10 ----------
python_11 = GhPythonScript(mesh=data_13)  # -> out, mesh, a, b
# ---------- python_11: Python ----------
__author__ = "arpj"

import rhinoscriptsyntax as rs


a = rs.JoinCurves([rs.AddLine(*mesh.edge_coordinates(*edge)) for edge in mesh.edges_where({'direction':'u'})])
b = rs.JoinCurves([rs.AddLine(*mesh.edge_coordinates(*edge)) for edge in mesh.edges_where({'direction':'v'})])
# ---------- end python_11 ----------
num_11 = Number(python_10.q)
num_12 = Number(python_10.radius)
num_13 = Number(python_10.forces)
crv_26 = Curve(python_9.edges)
mesh_7 = Mesh(python_9.faces)
pt_8 = Point(python_9.vertices)
crv_27 = Curve(python_11.b)
crv_28 = Curve(python_11.a)
data_15 = Data(python_11.mesh)
num_14 = Number(num_13)
crv_29 = Curve(crv_26)
crv_30 = Curve(crv_27)
crv_31 = Curve(crv_28)
end = EndPoints(Curve=crv_29)  # -> Start, End
python_12 = GhPythonScript(data=num_14)  # -> out, colors, colors_bar; inputs data: list
# ---------- python_12: Python ----------
import rhinoscriptsyntax as rs
from compas.utilities import i_to_rgb


dmin = min(data)
dmax = max(data)

print(dmin, dmax)
colors = [rs.CreateColor(i_to_rgb(value / dmax)) for value in data]
colors_bar = [rs.CreateColor(i_to_rgb((num * 0.10 * dmax))) for num in range(int(dmin), int(dmax), 10)]
# ---------- end python_12 ----------
entwine_3 = Entwine(Branch00=crv_31, Branch01=crv_30, FlattenInputs=True)
duppt = RemoveDuplicatePts(Points=[end.Start, end.End], Tolerance=0.01)
cp_2 = ControlPoints(Curve=entwine_3)  # -> Points, Weights, Knots
pdecon = Deconstruct(Point=duppt)  # -> XComponent, YComponent, ZComponent
intcrv = Interpolate(Vertices=cp_2.Points, Degree=3, Periodic=False, KnotStyle=1)  # -> Curve, Length, Domain
colour = Colour(python_12.colors)
crv_32 = Curve(crv_26)
sort = SortList(Keys=pdecon.ZComponent)  # -> reverse(Keys), ValuesA
crv_33 = Curve(intcrv.Curve)
item_2 = ListItem(List=sort.Keys, Index=0, Wrap=True)
previewlw = CustomPreviewLineweights(Geometry=crv_32, Shader=colour, Thickness="3", Absolute=False)
num_15 = Number(item_2)
num_16 = Number(Slider(1, range=0..1))
crv_34 = Curve(crv_26)
crv_35 = Curve(reparameterize(crv_33))
num_17 = Number(num_16)
num_18 = Number(num_15)
num_19 = Number(num_13)
sort_2 = SortList(Keys=num_19)  # -> Keys, ValuesA
patch = Patch(Curves=crv_34, Spans=20, Flexibility=1, Trim=True)
len = Length(Curve=crv_35)
graph_2 = QuickGraph(sort_2.Keys, SortOrder=0)
max_height_m = Panel(num_18)
division = Division(A=len, B=num_17)
srf = Surface(patch)
range = Range(Domain=Domain(0, 1), Steps=division)
eval = EvaluateCurve(Curve=crv_35, Parameter=range)  # -> Point, Tangent, Angle
vec = Vector(eval.Tangent)
pt_9 = Point(eval.Point)

scale = Slider(7, range=0..10)
Y = Slider(60, range=0..60)
neg = Negative(Value=Y)
X = UnitX(Factor=1)
rad = Radians(Degrees=Slider(0, range=0..100))
rad_2 = Radians(Degrees=Slider(88, range=0..100))
pt_10 = ConstructPoint(XCoordinate=Slider(-10, range=-10..10), YCoordinate=neg, ZCoordinate=Slider(30, range=0..30))
Y_2 = UnitY(Factor=1)
xz = XZPlane(Origin=pt_10)
line = LineSDL(Start=pt_10, Direction=X, Length=1)
rot3d = Rotate3D(Geometry=xz, Angle=rad_2, Center=pt_10, Axis=Vector(0, 0, 1))  # -> Geometry, Transform
rot3d_2 = Rotate3D(Geometry=rot3d.Geometry, Angle=rad, Center=pt_10, Axis=line)  # -> Geometry, Transform
rectangle = Rectangle(Plane=rot3d.Geometry, XSize=Domain(-1, 1), YSize=Domain(-2, 2), Radius=0)  # -> Rectangle, Length
area = Area(Geometry=rectangle.Rectangle)  # -> Area, Centroid
scale_2 = Scale(Geometry=rectangle.Rectangle, Center=area.Centroid, Factor=scale)  # -> Geometry, Transform
crv_36 = Curve(scale_2.Geometry)
num_20 = Number(num_13)
bnd_2 = Bounds(Numbers=num_20)
dedomain = DeconstructDomain(Domain=bnd_2)  # -> Start, End
range_2 = Range(Domain=bnd_2, Steps=10)
gradient = Gradient(
    LowerLimit=dedomain.End,
    UpperLimit=dedomain.Start,
    Parameter=range_2,
    stops=[0: RGB(255, 5, 5), 0.365: RGB(255, 255, 0), 0.66: RGB(0, 200, 255), 1: RGB(0, 34, 255)])
eval_2 = Evaluate(F="round(x, 4)", x=range_2)
crv_37 = Curve(crv_36)
concat = Concatenate(FragmentA=eval_2, FragmentB=" kN")
legend = Legend(Colour=gradient, Tags=concat, Rectangle=crv_37, LegendType=1)  # disabled

pt_11 = Point(pt_9)
srf_2 = Surface(srf)
srf_cp = SurfaceClosestPoint(Point=pt_11, Surface=srf_2)  # -> Point, UVPoint, Distance
evalsrf = EvaluateSurface(Surface=srf_2, Point=srf_cp.UVPoint)  # -> Point, Normal, UDirection, VDirection, Frame
vec_2 = Vector(evalsrf.Normal)
vec_3 = Vector(vec_2)
vec_4 = Vector(vec)
pt_12 = Point(pt_9)
xprod = CrossProduct(VectorA=vec_3, VectorB=vec_4, Unitize=False)  # -> Vector, Length
pl = ConstructPlane(Origin=pt_12, XAxis=xprod.Vector, YAxis=vec_3)
pln = Plane(pl)
pln_2 = Plane(pln)
num_21 = Number(Slider(0.9, range=0..1))
num_22 = Number(Slider(0.3, range=0..1))
num_23 = Number(num_21)
num_24 = Number(num_22)
division_2 = Division(A=num_23, B=2)
division_3 = Division(A=num_24, B=2)
num_25 = Number(num_21)
num_26 = Number(num_22)
neg_2 = Negative(Value=division_2)
neg_3 = Negative(Value=division_3)
dom_2 = ConstructDomain(DomainStart=neg_2, DomainEnd=division_2)
dom_3 = ConstructDomain(DomainStart=neg_3, DomainEnd=division_3)
division_4 = Division(A=num_26, B=2)
domain = Domain(dom_2)
domain_2 = Domain(domain)
domain_3 = Domain(dom_3)
domain_4 = Domain(domain_3)
rectangle_2 = Rectangle(Plane=pln_2, XSize=domain_4, YSize=domain_2, Radius=0)  # -> Rectangle, Length
crv_38 = Curve(rectangle_2.Rectangle)
crv_39 = Curve(crv_38)
loft = Loft(Curves=crv_39, Options={Adjust=False, Closed=False, LoftEnds=0, LoftSimp=0, LoftType=0, Rebuild=10, Refit=0.01})
cap = CapHoles(Brep=loft)
neg_4 = Negative(Value=num_25)
neg_5 = Negative(Value=division_4)
dom_4 = ConstructDomain(DomainStart=neg_4, DomainEnd=num_25)
dom_5 = ConstructDomain(DomainStart=neg_5, DomainEnd=division_4)
domain_5 = Domain(dom_4)
domain_6 = Domain(dom_5)
pln_3 = Plane(pln)
domain_7 = Domain(domain_5)
domain_8 = Domain(domain_6)
rectangle_3 = Rectangle(Plane=pln_3, XSize=domain_8, YSize=domain_7, Radius=0)  # -> Rectangle, Length
brep = Brep(cap)
simplify = SimplifyTree(Tree=cap, Front=False)
crv_40 = Curve(rectangle_3.Rectangle)
trim_2 = TrimTree(Tree=simplify, Depth=1)
crv_41 = Curve(crv_40)
bang = ExplodeTree(Data=trim_2)  # -> Branch0, Branch1
loft_2 = Loft(Curves=crv_41, Options={Adjust=False, Closed=False, LoftEnds=0, LoftSimp=0, LoftType=0, Rebuild=10, Refit=0.01})
brep_2 = Brep(brep)
graft_2 = GraftTree(Tree=bang.Branch0, IncludeEmptyLists=True, IncludeNullItems=True)
cap_2 = CapHoles(Brep=loft_2)
material = CreateMaterial(
    Diffuse=ColourSwatch(SwatchColor=RGB(222, 185, 22)),
    Specular=RGB(255, 255, 255),
    Emission=RGB(0, 0, 0),
    Transparency=0,
    Shine=0)
brep_3 = Brep(cap_2)
simplify_2 = SimplifyTree(Tree=brep_3, Front=False)
trim_3 = TrimTree(Tree=simplify_2, Depth=1)
bang_2 = ExplodeTree(Data=trim_3)  # -> Branch0, Branch1
graft_3 = GraftTree(Tree=bang_2.Branch1, IncludeEmptyLists=True, IncludeNullItems=True)
sdiff = SolidDifference(BrepsA=graft_2, BrepsB=bang_2.Branch1)
brep_4 = Brep(sdiff)
brep_5 = Brep(bang.Branch1)
preview = CustomPreview(Geometry=brep_2, Material=material)  # disabled
