# Grasshopper definition equad.ghx.gh (Grasshopper 1.0.7)
# plug-ins: Human

python = GhPythonScript()  # -> out, dva, dea
# ---------- python: Python ----------
__author__ = "Rafael Pastrana"


import scriptcontext as sc


dva = {
    'is_fixed': False,
    'x': 0.0,
    'y': 0.0,
    'z': 0.0,
    'px': 0.0,  # x component of point load at vertices
    'py': 0.0,  # y component of point load at vertices
    'pz': 1.0,  # z component of point load at vertices
    'rx': 0.0,
    'ry': 0.0,
    'rz': 0.0,
}

dea = {
    'qpre': 1.0,  # prescribed force densities
    'fpre': 0.0,  # prescribed edge forces
    'lpre': 0.0,  # prescribed edge lengths
    'linit': 0.0,  # initial edge length
    'E': 20.0,  # initial edge length (kN/mm2 => GPa)
    'radius': 1.0, # global initial cable radius (mm)
}

sc.sticky['dva'] = dva
sc.sticky['dea'] = dea
# ---------- end python ----------
python_2 = GhPythonScript()  # -> out, mesh
# ---------- python_2: Python ----------
__author__ = "Rafael Pastrana"

import compas
from compas.datastructures import Mesh


mesh = Mesh.from_obj(compas.get('faces.obj'))
# ---------- end python_2 ----------
merge = Merge(Data1=Slider(14, range=0..100), Data2=Slider(10, range=0..100), Data3=Slider(33, range=0..100))
python_3 = GhPythonScript(mesh=python_2.mesh)  # -> out, mesh
# ---------- python_3: Python ----------
__author__ = "arpj"


from compas.datastructures import mesh_subdivide

mesh = mesh_subdivide(mesh, k=1)
# ---------- end python_3 ----------
data = Data(python_3.mesh)
python_4 = GhPythonScript(mesh=data)  # -> out, ghmesh
# ---------- python_4: Python ----------
__author__ = "arpj"


from compas_ghpython.artists import MeshArtist

artist = MeshArtist(mesh)


ghmesh = artist.draw_mesh()
# ---------- end python_4 ----------
python_5 = GhPythonScript(mesh=data, indices=merge)  # -> out, points; inputs indices: list of Int32
# ---------- python_5: Python ----------
__author__ = "arpj"


points = []
for key in mesh.vertices():
    if key not in indices:
        continue
    xyz = mesh.vertex_coordinates(key)
    points.append(xyz)
# ---------- end python_5 ----------
python_6 = GhPythonScript(mesh=data)  # -> out, points
# ---------- python_6: Python ----------
__author__ = "arpj"


points = []
for key in mesh.vertices():
    if mesh.vertex_degree(key) == 2:
        xyz = mesh.vertex_coordinates(key)
        points.append(xyz)
# ---------- end python_6 ----------
python_7 = GhPythonScript(mesh=data)  # -> out, points; disabled
# ---------- python_7: Python ----------
__author__ = "arpj"


points = []
for key in mesh.vertices_on_boundary():
    xyz = mesh.vertex_coordinates(key)
    points.append(xyz)
# ---------- end python_7 ----------
merge_2 = Merge(Data1=python_6.points, Data2=python_7.points, Data3=python_5.points)  # -> flatten(Result)
python_8 = GhPythonScript(ghmesh=python_4.ghmesh, points=merge_2, projected=python_5.points, my_z=Slider(-3.007, range=-10..0))  # -> out, mesh; inputs points: list, projected: list
# ---------- python_8: Python ----------
__author__ = "Rafael Pastrana"


import scriptcontext as sc

from copy import deepcopy
from compas.datastructures import Mesh

from compas.utilities import geometric_key

from compas_rhino.helpers import mesh_from_guid
from compas_ghpython.artists import MeshArtist

# ==============================================================================
# Call Proxy Locally
# ==============================================================================


numerical = sc.sticky['numerical']
dr_numpy = numerical.dr_numpy

dea = sc.sticky['dea']
dva = sc.sticky['dva']

# mesh builder
mesh = mesh_from_guid(Mesh, ghmesh)

# update attributes
mesh.update_default_vertex_attributes(dva)
mesh.update_default_edge_attributes(dea)

# fix vertices
gkey_key = mesh.gkey_key()
projected = [geometric_key(pt) for pt in projected]

for point in points:
    gkey = geometric_key(point)
    vkey = gkey_key[gkey]
    mesh.set_vertex_attribute(vkey, 'is_fixed', True)
    if gkey in projected:
       mesh.set_vertex_attribute(vkey, 'z', my_z)
        
        

# query attributes
k_i = mesh.key_index()
vertices = mesh.get_vertices_attributes(('x', 'y', 'z'))
edges = [(k_i[u], k_i[v]) for u, v in mesh.edges()]
fixed = [k_i[key] for key in mesh.vertices_where({'is_fixed': True})]
loads = mesh.get_vertices_attributes(('px', 'py', 'pz'))
qpre = mesh.get_edges_attribute('qpre')
fpre = mesh.get_edges_attribute('fpre')
lpre = mesh.get_edges_attribute('lpre')
linit = mesh.get_edges_attribute('linit')
E = mesh.get_edges_attribute('E')
radius = mesh.get_edges_attribute('radius')

# carry out dynamic relaxation with numpy

xyz, q, f, l, r = dr_numpy(vertices,
                           edges,
                           fixed,
                           loads,
                           qpre,
                           fpre,
                           lpre,
                           linit,
                           E,
                           radius,
                           kmax=100,
                           callback=None
                           )

# update vertex coordinates
for key, attr in mesh.vertices(True):
    index = k_i[key]
    attr['x'] = xyz[index][0]
    attr['y'] = xyz[index][1]
    attr['z'] = xyz[index][2]
        
# update edges' force and length attributes 
for index, (u, v, attr) in enumerate(mesh.edges(True)):
    attr['f'] = f[index]
    attr['l'] = l[index]
# ---------- end python_8 ----------
python_9 = GhPythonScript(mesh=python_8.mesh)  # -> out, vertices, edges, faces
# ---------- python_9: Python ----------
__author__ = "Rafael Pastrana"

from compas_ghpython.artists import MeshArtist


# ==============================================================================
# Visualize
# ==============================================================================

artist = MeshArtist(mesh)

# vertices = artist.draw_vertices()
edges = artist.draw_edges()
faces = artist.draw_faces()
mesh = artist.draw_mesh()
# ---------- end python_9 ----------
panel = Panel(python_8.out)
mesh = Mesh(python_9.faces)
pt = Point(python_9.vertices)
crv = Curve(python_9.edges)
data_2 = Data(python_8.mesh)
python_10 = GhPythonScript(mesh=data_2)  # -> out, q, forces, radius
# ---------- python_10: Python ----------
forces = [attr['f'][0] for u , v, attr in mesh.edges(True)]
# ---------- end python_10 ----------
num = Number(python_10.q)
num_2 = Number(python_10.forces)
num_3 = Number(python_10.radius)
num_4 = Number(num_2)
python_11 = GhPythonScript(data=num_4)  # -> out, colors; inputs data: list
# ---------- python_11: Python ----------
import rhinoscriptsyntax as rs
from compas.utilities import i_to_rgb


dmax = max(data)
colors = [rs.CreateColor(i_to_rgb(value / dmax)) for value in data]
# ---------- end python_11 ----------
sort = SortList(Keys=num_4)  # -> Keys, ValuesA
crv_2 = Curve(crv)
colour = Colour(python_11.colors)
graph = QuickGraph(sort.Keys, SortOrder=0)
previewlw = CustomPreviewLineweights(Geometry=crv_2, Shader=colour, Thickness="3", Absolute=False)
