# Grasshopper definition equad_2.ghx (Grasshopper 1.0.7)
# plug-ins: Human

number_divs_90º = Slider(12, range=0..100)
number_divs_45º = Slider(8, range=0..100)

factor_planarization = Slider(1, range=0..1)
num = Number(factor_planarization)

mesh_offset = Slider(0.75, range=0..1)
panel_thicknes = Slider(0.2, range=0..1)
offset_frame = Slider(0.05, range=0..1)
num_2 = Number(mesh_offset)
num_3 = Number(panel_thicknes)
num_4 = Number(offset_frame)

q_col_factor = Slider(12, range=1..12)
num_5 = Number(q_col_factor)

k_dr = Slider(100, range=0..100)
num_6 = Number(k_dr)

number_divs_90º_2 = Slider(17, range=0..100)
number_divs_tree = Slider(6, range=0..100)
number_divs_45º_2 = Slider(12, range=0..100)
z_tree = Slider(0, range=-10..20)
pipeline = GeometryPipeline(
    GroupByLayer=False,
    GroupByType=False,
    IncludeHidden=True,
    IncludeLocked=True,
    LayerFilter="supports",
    NameFilter="*",
    SublayerFiltering=True,
    TypeFilter=1)

sampling_distance_for_perp_frames = Slider(1, range=0..1)
num_7 = Number(sampling_distance_for_perp_frames)

num_8 = Number(Slider(0.9, range=0..1))
num_9 = Number(Slider(0.3, range=0..1))

pt = Point(pipeline)
crv = Curve(<curve referenced from the Rhino model>)
num_10 = Number(z_tree)
num_11 = Number(Slider(0, range=0..100))
num_12 = Number(Slider(2, range=0..10))
num_13 = Number(number_divs_tree)
pt_2 = Point(<point referenced from the Rhino model>)
crv_2 = Curve(<curve referenced from the Rhino model>)
crv_3 = Curve(crv)
num_14 = Number(num_13)
num_15 = Number(num_13)
boundary = BoundarySurfaces(Edges=crv_3)
sdivide = DivideSurface(Surface=boundary, UCount=num_14, VCount=num_15)  # -> simplify(Points), Normals, Parameters
pt_3 = Point(sdivide.Points)
flip = FlipMatrix(Data=sdivide.Points)
pline = PolyLine(Vertices=sdivide.Points, Closed=False)
pline_2 = PolyLine(Vertices=flip, Closed=False)
entwine = Entwine(Branch00=pline_2, Branch01=pline, FlattenInputs=True)
explode = Explode(Curve=entwine, Recursive=True)  # -> Segments, Vertices
flatten = FlattenTree(Tree=explode.Segments, Path="{0}")
crv_4 = Curve(explode.Segments)
crv_5 = Curve(entwine)
crv_6 = Curve(flatten)
pt_4 = Point(pt_3)
crv_7 = Curve(crv_5)
item = ListItem(List=crv_7, Index=0, Wrap=True)  # -> Item1, Item
relitem = RelativeItem(Tree=pt_4, Offset="{1}[1]", WrapPaths=False, WrapItems=False)  # -> ItemA, ItemB
relitem_2 = RelativeItem(Tree=pt_4, Offset="{-1}[1]", WrapPaths=False, WrapItems=False)  # -> ItemA, ItemB
merge = Merge(Data1=item.Item1, Data2=item.Item)
ln = Line(StartPoint=relitem.ItemA, EndPoint=relitem.ItemB)
ln_2 = Line(StartPoint=relitem_2.ItemA, EndPoint=relitem_2.ItemB)
crv_8 = Curve(ln)
crv_9 = Curve(ln_2)
crv_10 = Curve(merge)
crv_11 = Curve(crv_8)
crv_12 = Curve(crv_9)
crv_13 = Curve(crv_10)
flatten_2 = FlattenTree(Tree=crv_11, Path="{0}")
graft = GraftTree(Tree=crv_12, IncludeEmptyLists=True, IncludeNullItems=True)
ccx = CurveCurve(CurveA=graft, CurveB=flatten_2)  # -> Points, ParamsA, ParamsB
path_mapper = PathMapper(ccx.ParamsB, source="{A;B;C}", target="{C}")
trim = TrimTree(Tree=ccx.ParamsA, Depth=1)
shatter = Shatter(Curve=graft, Parameters=trim)
shatter_2 = Shatter(Curve=graft(flatten_2), Parameters=path_mapper)
explode_2 = Explode(Curve=shatter, Recursive=True)  # -> Segments, Vertices
explode_3 = Explode(Curve=shatter_2, Recursive=True)  # -> Segments, Vertices
crv_14 = Curve(explode_3.Segments)
crv_15 = Curve(crv_14)
crv_16 = Curve(explode_2.Segments)
crv_17 = Curve(crv_16)
entwine_2 = Entwine(Branch00=crv_17, Branch01=crv_15, Branch02=crv_13, FlattenInputs=True)
crv_18 = Curve(entwine_2)
crv_19 = Curve(crv_18)
explode_4 = Explode(Curve=crv_19, Recursive=True)  # -> Segments, Vertices
flatten_3 = FlattenTree(Tree=explode_4.Segments, Path="{0}")
crv_20 = Curve(flatten_3)
crv_21 = Curve(crv_20)
python = GhPythonScript(lines=crv_21)  # -> out, mesh, ghmesh, faces; inputs lines: list
# ---------- python: Python ----------
from compas.datastructures import Mesh

from compas_rhino.utilities import get_line_coordinates
from compas_ghpython.artists import MeshArtist


mesh = Mesh.from_lines(get_line_coordinates(lines), delete_boundary_face=True)

a = MeshArtist(mesh)
ghmesh = a.draw_mesh()
faces = a.draw_faces()
# ---------- end python ----------
data = Data(python.mesh)
mesh = Mesh(python.ghmesh)
mesh_2 = Mesh(python.faces)
pt_5 = Point(pt_2)
num_16 = Number(num_11)
mesh_3 = Mesh(mesh_2)
num_17 = Number(num_12)
dom = ConstructDomain(DomainStart=num_17, DomainEnd=num_16)
facen = FaceNormals(Mesh=mesh_3)  # -> Centers, Normals
dist = Distance(PointA=facen.Centers, PointB=pt_5)
sqr = Square(Value=dist)
bnd = Bounds(Numbers=flatten(sqr))
remap = RemapNumbers(Value=sqr, Source=bnd, Target=Domain(0, 1))  # -> Mapped, Clipped
graph = GraphMapper(
    remap.Mapped,
    x0=0,
    x1=1,
    y0=0,
    y1=1,
    container_name="Bezier",
    cpx=[0, 0.1434025466, 0, 1],
    cpy=[0, 0, 0.8176158667, 0.9953248501])
remap_2 = RemapNumbers(Value=graph, Source=Domain(0, 1), Target=dom)  # -> flatten(Mapped), Clipped
subdivide = BooleanToggle(True)
int = Integer(remap_2.Mapped)
bool = Boolean(subdivide)
int_2 = Integer(flatten(int))
bool_2 = Boolean(bool)
crv_22 = Curve(crv_20)
crv_23 = Curve(crv_6)
pt_6 = Point(pt_2)
python_2 = GhPythonScript(subdivide=bool_2, lines=crv_22, subdivisions=int_2, attractor=pt_6)  # -> out, mesh, ghmesh, faces, edges; inputs subdivide: Boolean, lines: list, subdivisions: list of Int32, attractor: Point3d
# ---------- python_2: Python ----------
from compas.datastructures import Mesh
from compas.datastructures import mesh_split_edge

from compas_rhino.utilities import get_line_coordinates
from compas_ghpython.artists import MeshArtist

from compas.utilities import window
from compas.utilities import pairwise
from compas.utilities import geometric_key

from compas.geometry import is_point_in_polygon_xy
from compas.geometry import closest_point_in_cloud



def mesh_subdivide_quad(mesh, subdivisions):
    counter = 0
    base_mesh = mesh.copy()
    
    for _ in range(max(subdivisions)):
        # subd = mesh_fast_copy(mesh)
        subd = mesh.copy()
        
        # for u, v in list(subd.edges()):
        #    mesh_split_edge(subd, u, v, allow_boundary=True)
        
        for fkey in mesh.faces():
            
            centroid = mesh.face_centroid(fkey)
            
            
            for idx, ofkey in enumerate(base_mesh.faces()):
                polygon = base_mesh.face_coordinates(ofkey)
                if is_point_in_polygon_xy(centroid, polygon):
                    j = idx
                
            sval = subdivisions[j]
            if counter >= sval:
                continue
            
            edges = mesh.face_halfedges(fkey)
            for u, v in edges:
                try:
                    mesh_split_edge(subd, u, v, allow_boundary=True)
                except:
                    continue
            
            descendant = {i: j for i, j in subd.face_halfedges(fkey)}
            ancestor = {j: i for i, j in subd.face_halfedges(fkey)}
            x, y, z = mesh.face_centroid(fkey)
            c = subd.add_vertex(x=x, y=y, z=z)
            
            for key in mesh.face_vertices(fkey):
                a = ancestor[key]
                d = descendant[key]
                subd.add_face([a, key, d, c])
                
            del subd.face[fkey]
            
        mesh = subd
        counter += 1

    return subd


mesh = Mesh.from_lines(get_line_coordinates(lines), delete_boundary_face=True)

if subdivide:
    mesh = mesh_subdivide_quad(mesh, subdivisions)

    xyz_vkey = {geometric_key(mesh.vertex_coordinates(vkey)): vkey for vkey in mesh.vertices()}
    xyz_all = map(mesh.vertex_coordinates, mesh.vertices())

    _, closest, b = closest_point_in_cloud([attractor.X, attractor.Y, attractor.Z], xyz_all)
    gkey = geometric_key(closest)

    vkey = xyz_vkey[gkey]
    mesh.delete_vertex(vkey)


a = MeshArtist(mesh)
ghmesh = a.draw_mesh()
faces = a.draw_faces()
edges = a.draw_edges()
# ---------- end python_2 ----------
data_2 = Data(python_2.mesh)
panel = Panel(python_2.out)
mesh_4 = Mesh(python_2.ghmesh)
crv_24 = Curve(python_2.edges)
mesh_5 = Mesh(python_2.faces)
data_3 = Data(data_2)
python_3 = GhPythonScript(mesh=data_3)  # -> out, mesh, a, b
# ---------- python_3: Python ----------
__author__ = "arpj"

import rhinoscriptsyntax as rs
from compas.utilities import geometric_key
from compas.geometry import dot_vectors
from compas.geometry import normalize_vector
from compas.geometry import subtract_vectors
from math import fabs


visited = set()
id = 0



edge1 = mesh.get_any_edge()
vector_a = normalize_vector(subtract_vectors(*mesh.edge_coordinates(*edge1)[::-1]))

visited = set()


for edge in mesh.edges():
    
    if mesh.is_edge_on_boundary(*edge):
        continue
    
    gkey = geometric_key(mesh.edge_midpoint(*edge))
    
    if gkey in visited:
        continue

    vector_b = normalize_vector(subtract_vectors(*mesh.edge_coordinates(*edge)[::-1]))
    
    dot = fabs(dot_vectors(vector_a, vector_b))
    if dot < 0.95:
        mesh.set_edge_attribute(edge, 'direction', 'u')
    else:
        mesh.set_edge_attribute(edge, 'direction', 'v')
    
    gkey = geometric_key(mesh.edge_midpoint(*edge))
    visited.add(gkey)



a = rs.JoinCurves([rs.AddLine(*mesh.edge_coordinates(*edge)) for edge in mesh.edges_where({'direction':'u'})])
b = rs.JoinCurves([rs.AddLine(*mesh.edge_coordinates(*edge)) for edge in mesh.edges_where({'direction':'v'})])
# ---------- end python_3 ----------
crv_25 = Curve(python_3.b)
data_4 = Data(python_3.mesh)
mesh_6 = Mesh(mesh_4)
data_5 = Data(data_4)
pt_7 = Point(pt)
demesh = DeconstructMesh(Mesh=mesh_6)  # -> Vertices, Faces, Colours, Normals
cp = ClosestPoint(Point=pt_7, Cloud=flatten(demesh.Vertices))  # -> ClosestPoint, CPIndex, Distance
python_4 = GhPythonScript(mesh=data_5, ghpoints=cp.ClosestPoint)  # -> out, points; inputs ghpoints: list
# ---------- python_4: Python ----------
__author__ = "arpj"


from compas_rhino.utilities import get_point_coordinates
from compas.utilities import geometric_key

ghpoints = get_point_coordinates(ghpoints)

gkey_key = mesh.gkey_key()


points = []
for ghpoint in ghpoints:
    pt = gkey_key[geometric_key(ghpoint)]
    points.append(ghpoint)
# ---------- end python_4 ----------
python_5 = GhPythonScript(mesh=data_5)  # -> out, points
# ---------- python_5: Python ----------
__author__ = "arpj"


points = []
for key in mesh.vertices_on_boundary():
    print(key)
    xyz = mesh.vertex_coordinates(key)
    points.append(xyz)
# ---------- end python_5 ----------
merge_2 = Merge(Data2=python_5.points, Data3=python_4.points)  # -> flatten(Result)
data_6 = Data(merge_2)
data_7 = Data(python_4.points)
data_8 = Data(data_6)
data_9 = Data(data_7)
num_18 = Number(num_10)
data_10 = Data(data_4)
num_19 = Number(num_6)
num_20 = Number(num_5)
python_6 = GhPythonScript(mesh=data_10, points=data_8, projected=data_9, my_z=num_18, q_col_factor=num_20, k_dr=num_19)  # -> out, mesh; inputs points: list, projected: list, k_dr: Int32
# ---------- python_6: Python ----------
__author__ = "Rafael Pastrana"


import scriptcontext as sc

from copy import deepcopy
from compas.datastructures import Mesh

from compas.utilities import geometric_key

from compas_rhino.helpers import mesh_from_guid
from compas_ghpython.artists import MeshArtist

# ==============================================================================
# Call Proxy Locally
# ==============================================================================


numerical = sc.sticky['numerical']
dr_numpy = numerical.dr_numpy

dea = sc.sticky['dea']
dva = sc.sticky['dva']

# mesh builder
# mesh = mesh_from_guid(Mesh, ghmesh)
mesh = deepcopy(mesh)

# update attributes
mesh.update_default_vertex_attributes(dva)
mesh.update_default_edge_attributes(dea)

# fix vertices
gkey_key = mesh.gkey_key()
projected = [geometric_key(pt) for pt in projected]

for point in points:
    gkey = geometric_key(point)
    vkey = gkey_key[gkey]
    mesh.set_vertex_attribute(vkey, 'is_fixed', True)
    if gkey in projected:
       mesh.set_vertex_attribute(vkey, 'z', my_z)
        
for edge in mesh.edges():
    zs = []
    for vkey in edge:
        if mesh.vertex_coordinates(vkey)[2] == my_z:
            q = mesh.get_edge_attribute(edge, 'qpre')
            mesh.set_edge_attribute(edge, 'qpre', q * q_col_factor)  # 12
            zs.append(vkey)
            
    if len(zs) == 2:
        mesh.set_edge_attribute(edge, 'qpre', q* 0.5)
    

# query attributes
k_i = mesh.key_index()
vertices = mesh.get_vertices_attributes(('x', 'y', 'z'))
edges = [(k_i[u], k_i[v]) for u, v in mesh.edges()]
fixed = [k_i[key] for key in mesh.vertices_where({'is_fixed': True})]
loads = mesh.get_vertices_attributes(('px', 'py', 'pz'))
qpre = mesh.get_edges_attribute('qpre')
fpre = mesh.get_edges_attribute('fpre')
lpre = mesh.get_edges_attribute('lpre')
linit = mesh.get_edges_attribute('linit')
E = mesh.get_edges_attribute('E')
radius = mesh.get_edges_attribute('radius')

# carry out dynamic relaxation with numpy

xyz, q, f, l, r = dr_numpy(vertices,
                           edges,
                           fixed,
                           loads,
                           qpre,
                           fpre,
                           lpre,
                           linit,
                           E,
                           radius,
                           kmax=k_dr,
                           callback=None
                           )

# update vertex coordinates
for key, attr in mesh.vertices(True):
    index = k_i[key]
    attr['x'] = xyz[index][0]
    attr['y'] = xyz[index][1]
    attr['z'] = xyz[index][2]
        
# update edges' force and length attributes 
for index, (u, v, attr) in enumerate(mesh.edges(True)):
    attr['f'] = f[index]
    attr['l'] = l[index]
# ---------- end python_6 ----------
python_7 = GhPythonScript()  # -> out
# ---------- python_7: Python ----------
__author__ = "Rafael Pastrana"


import scriptcontext as sc


dva = {
    'is_fixed': False,
    'x': 0.0,
    'y': 0.0,
    'z': 0.0,
    'px': 0.0,  # x component of point load at vertices
    'py': 0.0,  # y component of point load at vertices
    'pz': 10.0,  # z component of point load at vertices
    'rx': 0.0,
    'ry': 0.0,
    'rz': 0.0,
}

dea = {
    'qpre': 10.0,  # prescribed force densities
    'fpre': 0.0,  # prescribed edge forces
    'lpre': 0.0,  # prescribed edge lengths
    'linit': 0.0,  # initial edge length
    'E': 10.0,  # initial edge length (kN/mm2 => GPa)
    'radius': 2.5, # global initial cable radius (mm)
}

sc.sticky['dva'] = dva
sc.sticky['dea'] = dea
# ---------- end python_7 ----------
panel_2 = Panel(python_6.out)
data_11 = Data(python_6.mesh)
data_12 = Data(data_11)
python_8 = GhPythonScript(mesh=data_12)  # -> out, keys, boundary_keys
# ---------- python_8: Python ----------
keys = [edge for edge in mesh.edges() if not mesh.is_edge_on_boundary(*edge)]

boundary_keys = [edge for edge in mesh.edges() if mesh.is_edge_on_boundary(*edge)]
# ---------- end python_8 ----------
data_13 = Data(python_8.keys)
data_14 = Data(python_8.boundary_keys)
data_15 = Data(data_11)
data_16 = Data(data_11)
data_17 = Data(data_13)
data_18 = Data(data_11)
data_19 = Data(data_13)
data_20 = Data(data_11)
data_21 = Data(data_14)
python_9 = GhPythonScript(mesh=data_15, keys=data_17)  # -> out, vertices, edges, faces; inputs keys: list
# ---------- python_9: Python ----------
__author__ = "Rafael Pastrana"

import rhinoscriptsyntax as rs
from compas_ghpython.artists import MeshArtist


# ==============================================================================
# Visualize
# ==============================================================================


artist = MeshArtist(mesh)


vkeys = set()
for u, v in keys:
    vkeys.add(u)
    vkeys.add(v)
    
vertices = [rs.AddPoint(*mesh.vertex_coordinates(v)) for v in vkeys]
edges = artist.draw_edges(keys=keys)
faces = artist.draw_faces()
mesh = artist.draw_mesh()
# ---------- end python_9 ----------
python_10 = GhPythonScript(mesh=data_18, keys=data_19)  # -> out, forces; inputs keys: list
# ---------- python_10: Python ----------
forces = [attr['f'][0] for u , v, attr in mesh.edges(True) if (u, v) in keys]
# ---------- end python_10 ----------
python_11 = GhPythonScript(mesh=data_16)  # -> out, mesh, a, b
# ---------- python_11: Python ----------
__author__ = "arpj"

import rhinoscriptsyntax as rs


a = rs.JoinCurves([rs.AddLine(*mesh.edge_coordinates(*edge)) for edge in mesh.edges_where({'direction':'u'})])
b = rs.JoinCurves([rs.AddLine(*mesh.edge_coordinates(*edge)) for edge in mesh.edges_where({'direction':'v'})])
# ---------- end python_11 ----------
python_12 = GhPythonScript(mesh=data_20, keys=data_21)  # -> out, vertices, edges, faces; inputs keys: list; same code as python_9
num_21 = Number(python_10.forces)
mesh_7 = Mesh(python_9.faces)
crv_26 = Curve(python_9.edges)
pt_8 = Point(python_9.vertices)
crv_27 = Curve(python_11.b)
crv_28 = Curve(python_11.a)
data_22 = Data(python_11.mesh)
crv_29 = Curve(python_12.edges)
mesh_8 = Mesh(python_12.faces)
pt_9 = Point(python_12.vertices)
num_22 = Number(num_21)
crv_30 = Curve(crv_26)
crv_31 = Curve(crv_26)
crv_32 = Curve(crv_27)
crv_33 = Curve(crv_28)
crv_34 = Curve(crv_26)  # disabled
num_23 = Number(num_21)  # disabled
panel_3 = Panel("0.5")  # disabled
panel_4 = Panel("0.1")  # disabled
len = Length(Curve=crv_30)
python_13 = GhPythonScript(data=num_22)  # -> out, colors, colors_bar, data_bar; inputs data: list
# ---------- python_13: Python ----------
import rhinoscriptsyntax as rs
from compas.utilities import i_to_rgb


dmin = min(data)
dmax = max(data)

colors = [rs.CreateColor(i_to_rgb(value / dmax)) for value in data]


num_colors = 10
diff = dmax - dmin
delta = diff / num_colors
data_bar = [dmin + delta * num for num in range(num_colors + 1)]
colors_bar = [rs.CreateColor(i_to_rgb(num / dmax)) for num in data_bar]
# ---------- end python_13 ----------
panel_5 = Panel("/Users/arpj/Documents/princeton/coursework/spring_2020/cee_546/assignments/03/equad_courtyard/txt")
entwine_3 = Entwine(Branch00=crv_33, Branch01=crv_32, FlattenInputs=True)
end = EndPoints(Curve=crv_31)  # -> Start, End
ma = MassAddition(Input=len)  # -> Result, PartialResults
python_14 = GhPythonScript(edges=crv_34, data=num_23, radius_max=panel_3, radius_min=panel_4)  # -> out, radius, pipes; inputs edges: list, data: list; disabled
# ---------- python_14: Python ----------
import rhinoscriptsyntax as rs
from compas.utilities import i_to_rgb
from functools import partial


def remap(x, x1, x2, y1, y2):
    return y1 + (x - x1) * (y2 - y1) / (x2 - x1)


dmin = min(data)
dmax = max(data)

partial_remap = partial(remap, x1=dmin, x2=dmax, y1=radius_min, y2=radius_max)
radius = list(map(partial_remap, data))

pipes = []
for edge, rad in zip(edges, radius):
    pipes.append(rs.AddPipe(edge, [0, 1], radii=[rad, rad], cap=1)[0])
# ---------- end python_14 ----------
cp_2 = ControlPoints(Curve=entwine_3)  # -> Points, Weights, Knots
panel_6 = Panel(python_13.out)
colour = Colour(python_13.colors)
colour_2 = Colour(python_13.colors_bar)
num_24 = Number(python_13.data_bar)
pdecon = Deconstruct(Point=end.End)  # -> XComponent, YComponent, ZComponent
intcrv = Interpolate(Vertices=cp_2.Points, Degree=3, Periodic=False, KnotStyle=1)  # -> Curve, Length, Domain
panel_7 = Panel(python_14.out)  # disabled
sort = SortList(Keys=pdecon.ZComponent)  # -> reverse(Keys), ValuesA
brep = Brep(python_14.pipes)  # disabled
num_25 = Number(python_14.radius)  # disabled
crv_35 = Curve(intcrv.Curve)
item_2 = ListItem(List=sort.Keys, Index=0, Wrap=True)
num_26 = Number(len)
num_27 = Number(item_2)
num_28 = Number(ma.Result)
txt = Text(panel_5)
bool_3 = Boolean(Toggle(False))
brep_2 = Brep(brep)  # disabled
num_29 = Number(num_27)
num_30 = Number(num_21)
colour_3 = Colour(colour)  # disabled
num_31 = Number(num_28)
num_32 = Number(num_21)
num_33 = Number(num_26)
bool_4 = Boolean(bool_3)
txt_2 = Text(txt)

num_34 = Number(num_26)
num_35 = Number(num_21)

multiplication = Multiplication(A=num_32, B=num_33)
sort_2 = SortList(Keys=num_30)  # -> Keys, ValuesA
material = CreateMaterial(Diffuse=colour_3, Specular=RGB(255, 255, 255), Emission=RGB(0, 0, 0), Transparency=0, Shine=0)  # disabled
python_15 = GhPythonScript(export=bool_4, path=txt_2, forces=num_35, lengths=num_34)  # -> out; inputs export: Boolean, forces: list, lengths: list
# ---------- python_15: Python ----------
__author__ = "arpj"

import csv
from time import time
from itertools import izip_longest


now = time()
data = ['forces', 'lengths']


def writer(path, name, data):    
    filename = path + '/{}.txt'.format(name)
    
    with open(filename, 'a') as file:
        file.write(content + '\n')
        

def csv_writer(path, name, data):
    filename = path + '/{}.csv'.format(name)
    with open(filename, "wb") as csv_file:
        writer = csv.writer(csv_file, delimiter=',')
        for line in data:
            writer.writerow(line)


if export:
    forces = ['forces'] + forces
    lengths = ['lengths'] + lengths
    data = izip_longest(forces, lengths)
    csv_writer(path, str(now), data)
# ---------- end python_15 ----------
ma_2 = MassAddition(Input=multiplication)  # -> Result, PartialResults
swatch = ColourSwatch(SwatchColor=RGB(0, 0, 0))
colour_4 = Colour(colour)
crv_36 = Curve(crv_26)
graph_2 = QuickGraph(sort_2.Keys, SortOrder=0)
total_load_path = Panel(ma_2.Result)
max_height_m = Panel(num_29)
total_edge_length_m = Panel(num_31)
panel_8 = Panel(python_15)
previewlw = CustomPreviewLineweights(Geometry=crv_36, Shader=colour_4, Thickness="3", Absolute=False)
preview = CustomPreview(Geometry=brep_2, Material=material)  # disabled

load_arrow_base_circle_radius = Slider(0.2, range=0..1)  # disabled
support_cone_base_circle_radius = Slider(0.5, range=0..1)  # disabled
load_arrow_pipe_heght = Slider(1.5, range=0..2)  # disabled
load_arrow_move_up = Slider(0.7, range=0..2)  # disabled
num_36 = Number(load_arrow_base_circle_radius)  # disabled
num_37 = Number(load_arrow_pipe_heght)  # disabled
num_38 = Number(load_arrow_move_up)  # disabled
num_39 = Number(support_cone_base_circle_radius)  # disabled

crv_37 = Curve(crv_26)  # disabled
crv_38 = Curve(reparameterize(crv_35))  # disabled
num_40 = Number(num_7)  # disabled
patch = Patch(Curves=crv_37, Spans=20, Flexibility=1, Trim=True)  # disabled
len_2 = Length(Curve=crv_38)  # disabled
division = Division(A=len_2, B=num_40)  # disabled
srf = Surface(patch)  # disabled
range = Range(Domain=Domain(0, 1), Steps=division)  # disabled
eval = EvaluateCurve(Curve=crv_38, Parameter=range)  # -> Point, Tangent, Angle; disabled
vec = Vector(eval.Tangent)  # disabled
pt_10 = Point(eval.Point)  # disabled
pt_11 = Point(pt_10)  # disabled
srf_2 = Surface(srf)  # disabled
srf_cp = SurfaceClosestPoint(Point=pt_11, Surface=srf_2)  # -> Point, UVPoint, Distance; disabled
evalsrf = EvaluateSurface(Surface=srf_2, Point=srf_cp.UVPoint)  # -> Point, Normal, UDirection, VDirection, Frame; disabled
vec_2 = Vector(evalsrf.Normal)  # disabled
num_41 = Number(num_8)  # disabled
num_42 = Number(num_9)  # disabled
num_43 = Number(num_8)  # disabled
num_44 = Number(num_9)  # disabled
vec_3 = Vector(vec_2)  # disabled
vec_4 = Vector(vec)  # disabled
pt_12 = Point(pt_10)  # disabled
division_2 = Division(A=num_42, B=2)  # disabled
division_3 = Division(A=num_43, B=2)  # disabled
division_4 = Division(A=num_44, B=2)  # disabled
xprod = CrossProduct(VectorA=vec_3, VectorB=vec_4, Unitize=False)  # -> Vector, Length; disabled
neg = Negative(Value=num_41)  # disabled
neg_2 = Negative(Value=division_2)  # disabled
neg_3 = Negative(Value=division_3)  # disabled
neg_4 = Negative(Value=division_4)  # disabled
pl = ConstructPlane(Origin=pt_12, XAxis=xprod.Vector, YAxis=vec_3)  # disabled
dom_2 = ConstructDomain(DomainStart=neg, DomainEnd=num_41)  # disabled
dom_3 = ConstructDomain(DomainStart=neg_2, DomainEnd=division_2)  # disabled
dom_4 = ConstructDomain(DomainStart=neg_3, DomainEnd=division_3)  # disabled
dom_5 = ConstructDomain(DomainStart=neg_4, DomainEnd=division_4)  # disabled
pln = Plane(pl)  # disabled
domain = Domain(dom_2)  # disabled
domain_2 = Domain(dom_3)  # disabled
domain_3 = Domain(dom_4)  # disabled
domain_4 = Domain(dom_5)  # disabled
pln_2 = Plane(pln)  # disabled
domain_5 = Domain(domain_3)  # disabled
domain_6 = Domain(domain_4)  # disabled
pln_3 = Plane(pln)  # disabled
domain_7 = Domain(domain)  # disabled
domain_8 = Domain(domain_2)  # disabled
rectangle = Rectangle(Plane=pln_2, XSize=domain_6, YSize=domain_5, Radius=0)  # -> Rectangle, Length; disabled
rectangle_2 = Rectangle(Plane=pln_3, XSize=domain_8, YSize=domain_7, Radius=0)  # -> Rectangle, Length; disabled
crv_39 = Curve(rectangle.Rectangle)  # disabled
crv_40 = Curve(rectangle_2.Rectangle)  # disabled
crv_41 = Curve(crv_40)  # disabled
crv_42 = Curve(crv_39)  # disabled
loft = Loft(Curves=crv_41, Options={Adjust=False, Closed=False, LoftEnds=0, LoftSimp=0, LoftType=0, Rebuild=10, Refit=0.01})  # disabled
loft_2 = Loft(Curves=crv_42, Options={Adjust=False, Closed=False, LoftEnds=0, LoftSimp=0, LoftType=0, Rebuild=10, Refit=0.01})  # disabled
cap = CapHoles(Brep=loft)  # disabled
cap_2 = CapHoles(Brep=loft_2)  # disabled
brep_3 = Brep(cap)  # disabled
brep_4 = Brep(cap_2)  # disabled

data_23 = Data(data_11)  # disabled
num_45 = Number(num_2)  # disabled
python_16 = GhPythonScript(mesh=data_23, offset=num_45)  # -> out, mesh, face_polygons; disabled
# ---------- python_16: Python ----------
__author__ = "Rafael Pastrana"

import rhinoscriptsyntax as rs

from compas.datastructures import mesh_offset

from compas.geometry import bestfit_plane
from compas.geometry import project_points_plane
from compas.geometry import distance_point_point
from compas.geometry import subtract_vectors
from compas.geometry import normalize_vector
from compas.geometry import scale_vector
from compas.geometry import add_vectors


# ==============================================================================
# Visualize
# ==============================================================================

mesh = mesh.copy()
mesh = mesh_offset(mesh, offset)

face_polygons = []
offset_face_polygons = []


for fkey in mesh.faces():

    polygon = mesh.face_coordinates(fkey)    
    plane = bestfit_plane(polygon)
    
    new_polygon = project_points_plane(polygon, plane)
    
    distances = []
    for a, b in zip(polygon, new_polygon):
        dist = distance_point_point(a, b)
        distances.append(dist)
    
    factor = max(distances)
    new = []
    for a, b in zip(polygon, new_polygon):
        vec = normalize_vector(subtract_vectors(b, a))
        new.append(add_vectors(b, scale_vector(vec, factor)))
        
    new = new + new[:1]
    offset_face_polygons.append(rs.AddPolyline(new))
    
    new_polygon = new_polygon + new_polygon[:1]
    face_polygons.append(rs.AddPolyline(new_polygon))
# ---------- end python_16 ----------
crv_43 = Curve(python_16.face_polygons)  # disabled
panel_9 = Panel(python_16.out)
crv_44 = Curve(crv_43)  # disabled
num_46 = Number(num_4)  # disabled
num_47 = Number(num_3)  # disabled
planar = Planar(Curve=crv_44)  # -> Planar, Plane, Deviation; disabled
deplane = DeconstructPlane(Plane=planar.Plane)  # -> Origin, XAxis, YAxis, unitize(ZAxis); disabled
multiplication_2 = Multiplication(A=deplane.ZAxis, B=num_47)  # disabled
move = Move(Geometry=crv_44, Motion=multiplication_2)  # -> Geometry, Transform; disabled
crv_45 = Curve(move.Geometry)  # disabled
offset = OffsetCurve(Curve=crv_45, Distance=expr("-x", num_46), Plane=planar.Plane, Corners=1)  # disabled
entwine_4 = Entwine(Branch00=crv_45, Branch01=offset, FlattenInputs=True)  # disabled
multiplication_3 = Multiplication(A=multiplication_2, B=2)  # disabled
flip_2 = FlipMatrix(Data=entwine_4)  # disabled
rev = Reverse(Vector=multiplication_3)  # disabled
loft_3 = Loft(Curves=flip_2, Options={Adjust=False, Closed=False, LoftEnds=0, LoftSimp=0, LoftType=0, Rebuild=10, Refit=0.01})  # disabled
extr = Extrude(Base=flatten(offset), Direction=rev)  # disabled
extr_2 = Extrude(Base=flatten(loft_3), Direction=rev)  # disabled
cap_3 = CapHoles(Brep=extr)  # disabled
brep_5 = Brep(cap_3)  # disabled
brep_6 = Brep(extr_2)  # disabled

num_48 = Number(num_2)  # disabled
data_24 = Data(data_11)  # disabled
num_49 = Number(num)  # disabled
python_17 = GhPythonScript(mesh=data_24, offset=num_48, factor=num_49)  # -> out, face_polygons, colored_meshes, data_bar, colors_bar; disabled
# ---------- python_17: Python ----------
__author__ = "Rafael Pastrana"

import rhinoscriptsyntax as rs

from compas.datastructures import mesh_offset

from compas.geometry import bestfit_plane
from compas.geometry import project_points_plane
from compas.geometry import distance_point_point
from compas.geometry import subtract_vectors
from compas.geometry import scale_vector
from compas.geometry import add_vectors
from compas.geometry import flatness
from compas.geometry import centroid_points

from compas.utilities import i_to_rgb as color_mapping
from compas.utilities import pairwise

# ==============================================================================
# Planarization
# ==============================================================================

mesh = mesh.copy()
mesh = mesh_offset(mesh, offset)

face_polygons = []
polygons = []
new_polygons = []
fit_polygons = []
all_distances = []

for fkey in mesh.faces():

    polygon = mesh.face_coordinates(fkey)
    polygons.append(polygon)

    plane = bestfit_plane(polygon)
    
    new_polygon = project_points_plane(polygon, plane)
    fit_polygons.append(new_polygon)
    
    distances = []
    for a, b in zip(polygon, new_polygon):
        dist = distance_point_point(a, b)
        distances.append(dist)
    
    all_distances.extend(distances)
    
    new = []
    for pt, npt, d in zip(polygon, new_polygon, distances):
        vec = subtract_vectors(npt, pt)
        new.append(add_vectors(pt, scale_vector(vec, factor)))
    
    new_polygons.append(new)
    
    new = new + new[:1]
    face_polygons.append(rs.AddPolyline(new))

# ==============================================================================
# Flatness
# ==============================================================================

def add_colored_meshes(np, p, out_list, add_mesh=True):
    colors = []
    for npt, pt in zip(np, p):
        dist = distance_point_point(pt, npt)
        color = color_mapping(dist / max_dist)
        colors.append(rs.CreateColor(color))
    
    if add_mesh:
        out_list.append(rs.AddMesh(vertices, faces, vertex_colors=colors))
    
    return colors

min_dist = min(all_distances)
max_dist = max(all_distances)
colored_meshes = []

for np, p in zip(new_polygons, fit_polygons):
    
    vertices = np
    faces = [list(range(len(np)))]
    
    if len(vertices) <= 4:
        add_colored_meshes(np, p, colored_meshes)
        continue
        
    else:
        
        cpt = centroid_points(np)
        np.append(cpt)
        face = faces[0]
        
        new_idx = len(face)
        ngon_faces = []
        
        for c, d in pairwise(face + face[:1]):  # there should be only one face
            ngon_faces.append([c, d, new_idx])

        temp_dists = []
        ngon_colors = []
        for npt, pt in zip(np, p):
            dist = distance_point_point(pt, npt)
            temp_dists.append(dist)
            color = color_mapping(dist / max_dist)
            ngon_colors.append(rs.CreateColor(color))
        
        val = sum(temp_dists) / len(temp_dists)
        
        ngon_colors.append(rs.CreateColor(color_mapping(val / max_dist)))
        
        colored_meshes.append(rs.AddMesh(np, ngon_faces, vertex_colors=ngon_colors))
        
dmax = max_dist
dmin = min_dist
            
num_colors = 10
diff = dmax - dmin
delta = diff / num_colors
data_bar = [dmin + delta * num for num in range(num_colors + 1)]
colors_bar = [rs.CreateColor(color_mapping(num / dmax)) for num in data_bar]
# ---------- end python_17 ----------
crv_46 = Curve(python_17.face_polygons)  # disabled
mesh_9 = Mesh(python_17.colored_meshes)  # disabled
num_50 = Number(python_17.data_bar)  # disabled
col = Colour(python_17.colors_bar)  # disabled

pt_13 = Point(pt_8)  # disabled
pt_14 = Point(pt_9)  # disabled
num_51 = Number(num_38)  # disabled
difference = SetDifference(SetA=pt_13, SetB=pt_14)  # disabled
Z = UnitZ(Factor=num_51)  # disabled
move_2 = Move(Geometry=difference, Motion=Z)  # -> Geometry, Transform; disabled
pt_15 = Point(move_2.Geometry)  # disabled
pt_16 = Point(pt_15)  # disabled
pdecon_2 = Deconstruct(Point=pt_16)  # -> XComponent, YComponent, ZComponent; disabled
sort_3 = SortList(Keys=pdecon_2.ZComponent)  # -> Keys, ValuesA; disabled
item_3 = ListItem(List=sort_3.Keys, Index=0, Wrap=True)  # -> Item1, Item; disabled
pt_17 = ConstructPoint(XCoordinate=pdecon_2.XComponent, YCoordinate=pdecon_2.YComponent, ZCoordinate=item_3.Item1)  # disabled
pt_18 = Point(pt_17)  # disabled
pt_19 = Point(pt_18)  # disabled
num_52 = Number(num_36)  # disabled
num_53 = Number(num_37)  # disabled
pt_20 = Point(pt_9)  # disabled
num_54 = Number(num_39)  # disabled
xy = XYPlane(Origin=pt_19)  # disabled
Z_2 = UnitZ(Factor=num_53)  # disabled
multiplication_4 = Multiplication(A=num_54, B=3)  # disabled
multiplication_5 = Multiplication(A=num_52, B=0.5)  # disabled
multiplication_6 = Multiplication(A=num_52, B=3)  # disabled
neg_5 = Negative(Value=multiplication_4)  # disabled
cir = Circle(Plane=xy, Radius=multiplication_5)  # disabled
Z_3 = UnitZ(Factor=neg_5)  # disabled
pflip = FlipPlane(Plane=xy, ReverseX=True, ReverseY=True, SwapAxes=True)  # disabled
move_3 = Move(Geometry=pt_20, Motion=Z_3)  # -> Geometry, Transform; disabled
xy_2 = XYPlane(Origin=move_3.Geometry)  # disabled
extr_3 = Extrude(Base=cir, Direction=Z_2)  # disabled
cone = Cone(Base=pflip, Radius=num_52, Length=multiplication_6)  # -> Cone, Tip; disabled
cone_2 = Cone(Base=xy_2, Radius=num_54, Length=multiplication_4)  # -> Cone, Tip; disabled
join = BrepJoin(Breps=flatten([cone.Cone, extr_3]))  # -> Breps, Closed; disabled
cap_4 = CapHoles(Brep=cone_2.Cone)  # disabled
cap_5 = CapHoles(Brep=join.Breps)  # disabled
brep_7 = Brep(cap_4)  # disabled
brep_8 = Brep(cap_5)  # disabled

brep_9 = Brep(brep_7)  # disabled
swatch_2 = ColourSwatch(SwatchColor=RGB(178, 0, 0))  # disabled
swatch_3 = ColourSwatch(SwatchColor=RGB(0, 0, 0))  # disabled
debrep = DeconstructBrep(Brep=brep_9)  # -> Faces, Edges, Vertices; disabled
material_2 = CreateMaterial(Diffuse=swatch_2, Specular=RGB(255, 255, 255), Emission=RGB(0, 0, 0), Transparency=0, Shine=0)  # disabled
panel_10 = Panel("1")  # disabled
previewlw_2 = CustomPreviewLineweights(Geometry=debrep.Edges, Shader=swatch_3, Thickness=panel_10, Absolute=False)  # disabled
preview_2 = CustomPreview(Geometry=brep_9, Material=material_2)  # disabled

brep_10 = Brep(brep_8)  # disabled
swatch_4 = ColourSwatch(SwatchColor=RGB(91, 250, 62))  # disabled
swatch_5 = ColourSwatch(SwatchColor=RGB(0, 0, 0))  # disabled
debrep_2 = DeconstructBrep(Brep=brep_10)  # -> Faces, Edges, Vertices; disabled
material_3 = CreateMaterial(Diffuse=swatch_4, Specular=RGB(255, 255, 255), Emission=RGB(0, 0, 0), Transparency=0, Shine=0)  # disabled
panel_11 = Panel("2")  # disabled
previewlw_3 = CustomPreviewLineweights(Geometry=debrep_2.Edges, Shader=swatch_5, Thickness=panel_11, Absolute=False)  # disabled
preview_3 = CustomPreview(Geometry=brep_10, Material=material_3)  # disabled

Y = Slider(60, range=0..60)
scale = Slider(9, range=0..10)
neg_6 = Negative(Value=Y)
rad = Radians(Degrees=Slider(90, range=0..100))
pt_21 = ConstructPoint(XCoordinate=Slider(-10, range=-10..10), YCoordinate=neg_6, ZCoordinate=Slider(30, range=0..30))
xz = XZPlane(Origin=pt_21)
rot3d = Rotate3D(Geometry=xz, Angle=rad, Center=pt_21, Axis=Vector(0, 0, 1))  # -> Geometry, Transform
rectangle_3 = Rectangle(Plane=rot3d.Geometry, XSize=Domain(-1, 1), YSize=Domain(-2, 2), Radius=0)  # -> Rectangle, Length
area = Area(Geometry=rectangle_3.Rectangle)  # -> Area, Centroid
scale_2 = Scale(Geometry=rectangle_3.Rectangle, Center=area.Centroid, Factor=scale)  # -> Geometry, Transform
crv_47 = Curve(scale_2.Geometry)

brep_11 = Brep(brep_4)  # disabled
brep_12 = Brep(brep_3)  # disabled
simplify = SimplifyTree(Tree=brep_11, Front=False)  # disabled
simplify_2 = SimplifyTree(Tree=brep_12, Front=False)  # disabled
trim_2 = TrimTree(Tree=simplify, Depth=1)  # disabled
trim_3 = TrimTree(Tree=simplify_2, Depth=1)  # disabled
bang = ExplodeTree(Data=trim_2)  # -> Branch0, Branch1; disabled
bang_2 = ExplodeTree(Data=trim_3)  # -> Branch0, Branch1; disabled
graft_2 = GraftTree(Tree=bang_2.Branch1, IncludeEmptyLists=True, IncludeNullItems=True)  # disabled
graft_3 = GraftTree(Tree=bang.Branch0, IncludeEmptyLists=True, IncludeNullItems=True)  # disabled
sdiff = SolidDifference(BrepsA=graft_3, BrepsB=bang_2.Branch1)  # disabled
brep_13 = Brep(sdiff)  # disabled
brep_14 = Brep(bang.Branch1)  # disabled

num_55 = Number(num_24)  # disabled
colour_5 = Colour(colour_2)  # disabled
crv_48 = Curve(crv_47)  # disabled
panel_12 = Panel("round(x, 2)")  # disabled
eval_2 = Evaluate(F=panel_12, x=num_55)  # disabled
panel_13 = Panel(" kN")  # disabled
concat = Concatenate(FragmentA=eval_2, FragmentB=panel_13)  # disabled
legend = Legend(Colour=colour_5, Tags=concat, Rectangle=crv_48, LegendType=1)  # disabled

crv_49 = Curve(crv_46)  # disabled
mesh_10 = Mesh(mesh_9)  # disabled
swatch_6 = ColourSwatch(SwatchColor=RGB(0, 0, 0))  # disabled
panel_14 = Panel("1")  # disabled
previewlw_4 = CustomPreviewLineweights(Geometry=crv_49, Shader=swatch_6, Thickness=panel_14, Absolute=False)  # disabled
preview_4 = CustomPreview(
    Geometry=mesh_10,
    Material={diffuse=RGB(221, 160, 221), emission=RGB(66, 48, 66), shine=0.5, specular=RGB(255, 255, 255), transparency=0})  # disabled

brep_15 = Brep(brep_4)  # disabled
swatch_7 = ColourSwatch(SwatchColor=RGB(222, 185, 22))  # disabled
debrep_3 = DeconstructBrep(Brep=brep_15)  # -> Faces, Edges, Vertices; disabled
swatch_8 = ColourSwatch(SwatchColor=RGB(0, 0, 0))  # disabled
material_4 = CreateMaterial(Diffuse=swatch_7, Specular=RGB(255, 255, 255), Emission=RGB(0, 0, 0), Transparency=0, Shine=0)  # disabled
panel_15 = Panel("1")  # disabled
preview_5 = CustomPreview(Geometry=brep_15, Material=material_4)  # disabled
previewlw_5 = CustomPreviewLineweights(Geometry=debrep_3.Edges, Shader=swatch_8, Thickness=panel_15, Absolute=False)  # disabled

brep_16 = Brep(brep_5)  # disabled
brep_17 = Brep(brep_5)  # disabled
brep_18 = Brep(brep_6)  # disabled
swatch_9 = ColourSwatch(SwatchColor=RGB(66, 66, 66))  # disabled
swatch_10 = ColourSwatch(SwatchColor=RGB(207, 236, 252))  # disabled
debrep_4 = DeconstructBrep(Brep=brep_16)  # -> Faces, Edges, Vertices; disabled
panel_16 = Panel("0.45")  # disabled
swatch_11 = ColourSwatch(SwatchColor=RGB(0, 0, 0))  # disabled
material_5 = CreateMaterial(Diffuse=swatch_10, Specular=RGB(255, 255, 255), Emission=RGB(0, 0, 0), Transparency=panel_16, Shine=0)  # disabled
panel_17 = Panel("1")  # disabled
previewlw_6 = CustomPreviewLineweights(Geometry=debrep_4.Edges, Shader=swatch_11, Thickness=panel_17, Absolute=False)  # disabled
preview_6 = CustomPreview(Geometry=brep_18, Material=swatch_9)  # disabled
preview_7 = CustomPreview(Geometry=brep_17, Material=material_5)  # disabled

colour_6 = Colour(col)  # disabled
num_56 = Number(num_50)  # disabled
crv_50 = Curve(crv_47)  # disabled
panel_18 = Panel("round(x, 0)")  # disabled
panel_19 = Panel(" mm")  # disabled

multiplication_7 = Multiplication(A=num_56, B=1000)  # disabled

eval_3 = Evaluate(F=panel_18, x=multiplication_7)  # disabled
concat_2 = Concatenate(FragmentA=eval_3, FragmentB=panel_19)  # disabled
legend_2 = Legend(Colour=colour_6, Tags=concat_2, Rectangle=crv_50, LegendType=1)  # disabled
