# Grasshopper definition proxy_server.ghx (Grasshopper 1.0.7)

python = GhPythonScript(run_proxy=Toggle(True), stop_server=Toggle(False))  # -> out, a; inputs run_proxy: Boolean, stop_server: Boolean
# ---------- python: Python ----------
from compas.rpc import Proxy
import scriptcontext as sc

import compas.numerical

if run_proxy:
    proxy = Proxy('compas.numerical')
    sc.sticky['numerical'] = proxy
    
    if stop_server:
        proxy.stop_server()
# ---------- end python ----------
panel = Panel(python.out)
